# Grasshopper definition TopologicalPolyhedralization_Python_1.0.gh (Grasshopper 1.0.7)

C = Count(Slider(12, range=0..100))

B = Brep([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])
N = Step(0.5)
scale_nu = ScaleNU(Geometry=B, Plane=PlaneXY(0, 0, 0), ScaleX=N, ScaleY=N, ScaleZ=1)  # -> Geometry, Transform
series = Series(Start=0, Step=N, Count=C)
series_2 = Series(Start=0, Step=N, Count=C)
smesh = SimpleMesh(Brep=scale_nu.Geometry)
Y = UnitY(Factor=series_2)
X = UnitX(Factor=series)
move = Move(Geometry=graft(smesh), Motion=X)  # -> Geometry, Transform
move_2 = Move(Geometry=graft(move.Geometry), Motion=Y)  # -> flatten(Geometry), Transform
sml_interlocking_blocks = Mesh(move_2.Geometry)

# ---- group: Sample_Block_Set
B_2 = Brep([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])
series_3 = Series(Start=0, Step=0.6, Count=10)
series_4 = Series(Start=0, Step=0.6, Count=10)
smesh_2 = SimpleMesh(Brep=B_2)
X_2 = UnitX(Factor=series_3)
Y_2 = UnitY(Factor=series_4)
quad = Quadrangulate(Mesh=smesh_2, Angle=0.03490658504, Ratio=0.875)  # -> Mesh, Count
mesh = Mesh(quad.Mesh)
move_3 = Move(Geometry=graft(mesh), Motion=X_2)  # -> Geometry, Transform
move_4 = Move(Geometry=graft(move_3.Geometry), Motion=Y_2)  # -> flatten(Geometry), Transform
smlvoxel_meshes = Mesh(move_4.Geometry)

# ----
surfacemesh = Mesh(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)
topopolyhedral = GhPythonScript(M=surfacemesh, B=sml_interlocking_blocks)  # -> out, Blocks; inputs M: Mesh, B: list of Mesh
# ---------- topopolyhedral: Python ----------
__author__ = "pnourian"
__version__ = "2020.08.23"

import Rhino.Geometry as rg
blockMeshes=[]
for blockMesh in B:
    edgeLines=[blockMesh.TopologyEdges.EdgeLine(i) for i in range(blockMesh.TopologyEdges.Count)]
    doesIntersect=False
    for edgeLine in edgeLines:
        if rg.Intersect.Intersection.MeshLine(M,edgeLine)[1]!=None:
            doesIntersect=True
            break
    if doesIntersect:
        blockMeshes.append(blockMesh)
Blocks=blockMeshes
# ---------- end topopolyhedral ----------
